# Grasshopper definition vis.gh (Grasshopper 1.0.7)
# plug-ins: Geospatial, LunchBox, UrbanX_GH

# ----
# Network.geojson/xml
file_path = FilePath("E:\114_temp\008_代码集\005_java\matsim_preparation\src\main\resources\debug\berlinTest\network.geojson")
file_path_2 = FilePath("E:\114_temp\008_代码集\005_java\matsim_preparation\src\main\resources\debug\berlinTest\network.geojson")
read_geojson = ReadGeoJSON(File=file_path_2)  # -> Type, Geometry, Keys, Values
urban_visnetwork = Urban_VisNetwork()  # -> Nodes, Property4Nodes, Links, Property4Links

# ----
# Facilities.csv
file_path_3 = FilePath("E:\114_temp\008_代码集\005_java\matsim_preparation\src\main\resources\facilities.csv")
read_file = ReadFile(File=file_path_3, PerLineParse=True)
read_csv = ReadCSV(CSVString=read_file, Delimiter=",")  # -> Headers, Values
c_script = CSharpScript(x=read_csv.Values)  # -> A; inputs x: tree of String
# ---------- c_script: C# ----------
    DataTree<String> result = new DataTree<String>();
    for (int i = 0; i < x.BranchCount; i++)
    {
      GH_Path path = new GH_Path(i);
      for (int j = 0; j < x.Branches[i].Count; j++)
      {
        var temp = x.Branches[i][j].Trim('"');
        result.Add(temp, path);
      }
    }
    A = result;
# ---------- end c_script ----------
flip_matrix = FlipMatrix(Data=c_script)
list_item = ListItem(List=flip_matrix, Index=0, Wrap=True)  # -> Item, Item1, Item2, Item3, Item4, Item5
explode_tree = ExplodeTree()  # -> Branch0, Branch1
construct_point = ConstructPoint(XCoordinate=list_item.Item2, YCoordinate=list_item.Item3, ZCoordinate=0)
panel = Panel(read_csv.Headers)
text_tag_3d = TextTag3D(Location=construct_point, Text=list_item.Item1, Size=Slider(10, range=0..1000), Justification=7)

# ----
# Population.csv
file_path_4 = FilePath("E:\114_temp\008_代码集\005_java\matsim_preparation\src\main\resources\population.csv")
read_file_2 = ReadFile(File=file_path_4, PerLineParse=True)
read_csv_2 = ReadCSV(CSVString=read_file_2, Delimiter=",")  # -> Headers, Values
c_script_2 = CSharpScript(x=read_csv_2.Values)  # -> A; inputs x: tree of String; same code as c_script
flip_matrix_2 = FlipMatrix(Data=c_script_2)
panel_2 = Panel(read_csv_2.Headers)
list_item_2 = ListItem(List=flip_matrix_2, Index=0, Wrap=True)  # -> Item, Item1, Item2
data = Data(flatten(construct_point))
list_item_3 = ListItem(List=data, Index=flatten(list_item_2.Item1), Wrap=True)
